# Dynamo graph Changeelementnestedlist.dyn "16+Nested+Loops+02" (Dynamo 2.10.1.3976)

code_block = CodeBlock { 0..10; }
code_block_2 = CodeBlock { 0..6; }
code_block_3 = CodeBlock { 0..2; }
generate_points = Python(IN[0]=code_block, IN[1]=code_block_2, IN[2]=code_block_3)  # IronPython2
# ---------- generate_points.python (24 lines) ----------
# Load the Python Standard and DesignScript Libraries
import sys
import clr
clr.AddReference('ProtoGeometry')
from Autodesk.DesignScript.Geometry import *

# The inputs to this node will be stored as a list in the IN variables.
x_Coordinate = IN[0]
y_Coordinate = IN[1]
z_Coordinate = IN[2]
# Place your code below this line
xOutput = []
for val1 in x_Coordinate:
	yOutput = []
	for val2 in y_Coordinate:
		zOutput = []
		for val3 in z_Coordinate:
			myPoint = Point.ByCoordinates(val1,val2,val3)
			zOutput.append(myPoint)
		yOutput.append(zOutput)
	xOutput.append(yOutput)

# Assign your output to the OUT variable.
OUT = xOutput
# ----------------------------------------
# note: Changing values in nested list
# -- Dont lost the list hierarchy
python_script = Python(IN[0]=generate_points)  # IronPython2
# ---------- python_script.python (27 lines) ----------
# Load the Python Standard and DesignScript Libraries
import sys
import clr
clr.AddReference('ProtoGeometry')
from Autodesk.DesignScript.Geometry import *

# The inputs to this node will be stored as a list in the IN variables.
dataEnteringNode = IN


x= IN[0]

output= []
for list1 in x:
	output1 = []
	for list2 in list1:
	  	output2 = []
	  	for list3 in list2:
	  		mypoint = Point.ByCoordinates(list3.X,list3.Y,list3.Z +10)
	  		output2.append(mypoint)
	  	output1.append(output2)
	output.append(output1)

# Place your code below this line

# Assign your output to the OUT variable.
OUT = output
# ----------------------------------------
