# Dynamo graph LevelCollector.dyn (Dynamo 2.10.1.3976)

python_script = Python()  # IronPython2; unwired: IN[0]
# ---------- python_script.python (24 lines) ----------
# Load the Python Standard and DesignScript Libraries
import sys
import clr

clr.AddReference("RevitServices")
import RevitServices
from RevitServices.Persistence import DocumentManager
doc =  DocumentManager.Instance.CurrentDBDocument
 
clr.AddReference("RevitNodes")
import Revit
clr.ImportExtensions(Revit.Elements)
clr.ImportExtensions(Revit.GeometryConversion)
 
clr.AddReference("RevitAPI")
from Autodesk.Revit.DB import *

# The inputs to this node will be stored as a list in the IN variables.
# Place your code below this line

levels = FilteredElementCollector(doc).OfClass(Level).WhereElementIsNotElementType().ToElements()

# Assign your output to the OUT variable.
OUT = levels
# ----------------------------------------
