# Dynamo graph Loops.dyn (Dynamo 2.10.1.3976)

# group: FOR LOOP
python_script = Python()  # IronPython2; unwired: IN[0]
# ---------- python_script.python (13 lines) ----------
# Load the Python Standard and DesignScript Libraries
import sys
import clr
clr.AddReference('ProtoGeometry')
from Autodesk.DesignScript.Geometry import *
import random

output = []
for i in range(15):
	intvalue = random.randint(1,20)
	if intvalue%2 ==0:
		output.append(intvalue)
OUT = output
# ----------------------------------------

# group: Remainder
python_script_2 = Python()  # IronPython2; unwired: IN[0]
# ---------- python_script_2.python (11 lines) ----------
# Load the Python Standard and DesignScript Libraries
import sys
import clr
clr.AddReference('ProtoGeometry')
from Autodesk.DesignScript.Geometry import *

# The inputs to this node will be stored as a list in the IN variables.
dataEnteringNode = IN


OUT = 4%2
# ----------------------------------------

# group: While Loop
python_script_3 = Python()  # IronPython2; unwired: IN[0]
# ---------- python_script_3.python (15 lines) ----------
# Load the Python Standard and DesignScript Libraries
import sys
import clr
clr.AddReference('ProtoGeometry')
from Autodesk.DesignScript.Geometry import *
import random

output = []
count = 0
while count < 10:
	intvalue = random.randint(1,20)
	if intvalue%2 ==0:
		output.append(intvalue)
		count +=1
OUT = output
# ----------------------------------------

integer_slider = IntegerSlider(1, range=0..20 step 1)

# group: While Loop 2
python_script_4 = Python(IN[0]=integer_slider)  # IronPython2
# ---------- python_script_4.python (15 lines) ----------
# Load the Python Standard and DesignScript Libraries
import sys
import clr
clr.AddReference('ProtoGeometry')
from Autodesk.DesignScript.Geometry import *
import random

random.seed(IN[0])

intvalue = random.randint(1,20)
while intvalue%2 != 0:
	intvalue = random.randint(1,20)

	
OUT = intvalue
# ----------------------------------------

python_script_5 = Python()  # IronPython2; unwired: IN[0]
# ---------- python_script_5.python (20 lines) ----------
# Load the Python Standard and DesignScript Libraries
import sys
import clr
clr.AddReference('ProtoGeometry')
from Autodesk.DesignScript.Geometry import *
import random

# The inputs to this node will be stored as a list in the IN variables.
dataEnteringNode = IN

# Place your code below this line
output = []

for pt in range(10):
	intvalue = random.randint(0,20)
	if intvalue%2 ==0:
		output.append(intvalue)
		
# Assign your output to the OUT variable.
OUT = output
# ----------------------------------------
python_script_6 = Python()  # IronPython2; unwired: IN[0]; same code as python_script_5

# group: Continue
python_script_7 = Python(IN[0]=python_script_6)  # IronPython2
# ---------- python_script_7.python (19 lines) ----------
# Load the Python Standard and DesignScript Libraries
import sys
import clr
clr.AddReference('ProtoGeometry')
from Autodesk.DesignScript.Geometry import *

# The inputs to this node will be stored as a list in the IN variables.
dataEnteringNode = IN

# Place your code below this lineo
output = []

for val in IN[0]:
	if val == 8 or val == 10:
		continue
	output.append(val)

# Assign your output to the OUT variable.
OUT = output
# ----------------------------------------

python_script_8 = Python()  # IronPython2; unwired: IN[0]; same code as python_script_5

# group: Break
python_script_9 = Python(IN[0]=python_script_8)  # IronPython2
# ---------- python_script_9.python (19 lines) ----------
# Load the Python Standard and DesignScript Libraries
import sys
import clr
clr.AddReference('ProtoGeometry')
from Autodesk.DesignScript.Geometry import *

# The inputs to this node will be stored as a list in the IN variables.
dataEnteringNode = IN

# Place your code below this lineo
output = []

for val in IN[0]:
	if val == 14:
		break
	output.append(val)

# Assign your output to the OUT variable.
OUT = output
# ----------------------------------------
