# Dynamo graph NestedLoops.dyn (Dynamo 2.10.1.3976)

code_block = CodeBlock { 0..2; }
code_block_2 = CodeBlock { 0..10; }
code_block_3 = CodeBlock { 0..6; }
code_block_4 = CodeBlock { 0..2; }
# note: Creating point.bycoordinates node with crossproduct option...
python_script = Python(IN[0]=code_block_2, IN[1]=code_block_3, IN[2]=code_block_4)  # IronPython2
# ---------- python_script.python (27 lines) ----------
# Load the Python Standard and DesignScript Libraries
import sys
import clr
clr.AddReference('ProtoGeometry')
from Autodesk.DesignScript.Geometry import *

# The inputs to this node will be stored as a list in the IN variables.
dataEnteringNode = IN

x_Coordinates = IN[0]
y_Coordinates = IN[1]
z_Coordinates = IN[2]

xoutput= []
# Place your code below this line
for val1 in x_Coordinates:
	youtput= []
	for val2 in y_Coordinates:
	 	zoutput = []
	 	for val3 in z_Coordinates:
			mypoint = Point.ByCoordinates(val1,val2,val3)
			zoutput.append(mypoint)
		youtput.append(zoutput)
	xoutput.append(youtput)
	
# Assign your output to the OUT variable.
OUT = xoutput
# ----------------------------------------
