# Dynamo graph QuickSlowFilter.dyn (Dynamo 2.10.1.3976)

family_types = FamilyTypes("M_Single-Flush:0762 x 2032mm")  # graph input
python_script = Python(IN[0]=family_types)  # IronPython2
# ---------- python_script.python (38 lines) ----------
import clr

#Import Revit Nodes
clr.AddReference("RevitNodes")
import Revit
clr.ImportExtensions(Revit.Elements)

# Import RevitAPI
clr.AddReference("RevitAPI")
import Autodesk
from Autodesk.Revit.DB import *

# Import DocumentManager and TransactionManager
clr.AddReference("RevitServices")
from RevitServices.Persistence import DocumentManager

#The inputs to this node will be stored as a list in the IN variables.
doc = DocumentManager.Instance.CurrentDBDocument
family = UnwrapElement(IN[0])
#Filtered Element Collector
collector = FilteredElementCollector(doc, doc.ActiveView.Id)
#Quick Filter

filter = ElementCategoryFilter(BuiltInCategory.OST_Doors)
doors = collector.WherePasses(filter).ToElements()


#Slow Filter

instancefilter =  FamilyInstanceFilter(doc,family.Id)
doorinstance   =  collector.OfCategory(BuiltInCategory.OST_Doors).WherePasses(instancefilter).ToElementIds()





#Assign your output to the OUT variable.
OUT = collector
# ----------------------------------------
