# Dynamo graph TryAndExcept.dyn "17 Try And Except" (Dynamo 2.12.0.5650)

code_block = CodeBlock { 0..10; }
code_block_2 = CodeBlock { 0..6; }
code_block_3 = CodeBlock { 0..2; }
generate_points = Python(IN[0]=code_block, IN[1]=code_block_2, IN[2]=code_block_3)  # IronPython2
# ---------- generate_points.python (24 lines) ----------
# Load the Python Standard and DesignScript Libraries
import sys
import clr
clr.AddReference('ProtoGeometry')
from Autodesk.DesignScript.Geometry import *

# The inputs to this node will be stored as a list in the IN variables.
x_Coordinate = IN[0]
y_Coordinate = IN[1]
z_Coordinate = IN[2]
# Place your code below this line
xOutput = []
for val1 in x_Coordinate:
	yOutput = []
	for val2 in y_Coordinate:
		zOutput = []
		for val3 in z_Coordinate:
			myPoint = Point.ByCoordinates(val1,val2,val3)
			zOutput.append(myPoint)
		yOutput.append(zOutput)
	xOutput.append(yOutput)

# Assign your output to the OUT variable.
OUT = xOutput
# ----------------------------------------
python_script = Python(IN[0]=generate_points)  # IronPython2
# ---------- python_script.python (14 lines) ----------
# Load the Python Standard and DesignScript Libraries
import sys
import clr
clr.AddReference('ProtoGeometry')
from Autodesk.DesignScript.Geometry import *

# The inputs to this node will be stored as a list in the IN variables.
dataEnteringNode = IN

# Place your code below this line
pointList = IN[0]
pointList[1][1][1] = None
# Assign your output to the OUT variable.
OUT = pointList
# ----------------------------------------
change_z_of_points = Python(IN[0]=python_script)  # IronPython2
# ---------- change_z_of_points.python (23 lines) ----------
# Load the Python Standard and DesignScript Libraries
import sys
import clr
clr.AddReference('ProtoGeometry')
from Autodesk.DesignScript.Geometry import *

pointList = IN[0]

output = []
for ptLst1 in pointList:
	output1 = []
	for ptLst2 in ptLst1:
		output2 =[]
		for pt in ptLst2:
			try:
				myPoint = Point.ByCoordinates(pt.X,pt.Y,pt.Z + 10)
				output2.append(myPoint)
			except Exception, ex: 
				output2.append(ex)
		output1.append(output2)
	output.append(output1)
# Assign your output to the OUT variable.
OUT = output
# ----------------------------------------
change_z_of_points_2 = Python(IN[0]=python_script)  # IronPython2
# ---------- change_z_of_points_2.python (20 lines) ----------
# Load the Python Standard and DesignScript Libraries
import sys
import clr
clr.AddReference('ProtoGeometry')
from Autodesk.DesignScript.Geometry import *

pointList = IN[0]

output = []
for ptLst1 in pointList:
	output1 = []
	for ptLst2 in ptLst1:
		output2 =[]
		for pt in ptLst2:
			myPoint = Point.ByCoordinates(pt.X,pt.Y,pt.Z + 10)
			output2.append(myPoint)
		output1.append(output2)
	output.append(output1)
# Assign your output to the OUT variable.
OUT = output
# ----------------------------------------
